# Grasshopper definition 01_fabtory_robot_model_rh8.ghx (Grasshopper 1.0.8)
# plug-ins: RhinoCodePluginGH

reload = Button()
py3 = Python3Script()  # -> HERE, DATA, ROBOT_DESCRIPTION
# ---------- py3: Python ----------
import os

HERE = os.path.dirname(ghdoc.Path)
DATA = os.path.abspath(os.path.join(HERE, "..", "data"))
ROBOT_DESCRIPTION = os.path.abspath(os.path.join(DATA, "robot_description"))

print(HERE)
print(DATA)
print(ROBOT_DESCRIPTION)
# ---------- end py3 ----------
py3_2 = Python3Script(reload=reload)
# ---------- py3_2: Python ----------
if reload:
    from compas_ghpython import unload_modules
    unload_modules("compas")
    unload_modules("compas_fab")
    unload_modules("abb_fabrication_control")
    unload_modules("compas_rrc")
    unload_modules("extruder_control")

    unload_modules("fabrication_manager")
    #unload_modules("assembly_information_model")
    unload_modules('climate_aware_robotic_envelope')
# ---------- end py3_2 ----------

# ----
# Tool
list = ValueList({"measurement_tool": 0, "concrete_extruder": 1}, selected="measurement_tool")
panel = Panel("Attach a custom tool")
tools = Tools(G=list)
remove = Button()
add = Button()
attach_remove = PythonScript(tool=tools, attach=add, remove=remove)  # -> out, bang; disabled
# ---------- attach_remove: Python ----------
if attach:
    robot.attach_tool(tool)
if remove:
    robot.detach_tool()
# ---------- end attach_remove ----------

# ----
# Robot Model
panel_2 = Panel("abb_fabtory.srdf")

# ----
# forward kinematics
number_slider = Slider(34.9, range=-180..180)

# ----
# Load robot from local package
load = Button()
list_2 = ValueList({"abb_fabtory"}, selected="abb_fabtory")

load_robot_model = Python3Script(path=py3.ROBOT_DESCRIPTION, package=list_2, urdf_name="abb_fabtory.urdf", srdf_name=panel_2, load=load)  # -> out, robot_model
# ---------- load_robot_model: Python ----------
import os
from scriptcontext import sticky as st

import compas
import compas_fab

from compas_robots import RobotModel
from compas_robots.resources import LocalPackageMeshLoader

from compas_fab.robots import Robot

from compas_robots.scene import BaseRobotModelObject

# from compas_robots.ghpython.scene import RobotModelObject


#from compas_fab.robots import Robot
#from compas_fab.robots import RobotSemantics
#from compas_fab.ghpython import RobotArtist

packages = ["abb_irb6700_support", "abb_end_effectors", "abb_fabtory"]
loaders = []

for package in packages:
    loaders.append(LocalPackageMeshLoader(path, package))

#path directory
package_path = os.path.join(path, package)
print(package_path)

urdf_filename = os.path.join(package_path, "urdf", urdf_name)
srdf_filename = os.path.join(package_path, srdf_name)

assert os.path.isfile(urdf_filename)
assert os.path.isfile(srdf_filename)

compas.PRECISION = '12f'

# store robot in component
guid = str(ghenv.Component.InstanceGuid)
robot_key = "robot_" + guid

if robot_key not in st:
    st[robot_key] = None

#load robot model from urdf
if load:

    # Create robot model from URDF
    model = RobotModel.from_urdf_file(urdf_filename)
    model.load_geometry(*loaders, precision=12)
    
    st[robot_key] = model

robot_model = st[robot_key]
# ---------- end load_robot_model ----------

robot_model = Data(load_robot_model.robot_model)

info = Python3Script(robot_model=robot_model)  # -> out, a
# ---------- info: Python ----------
if robot_model:
    print(robot_model)
# ---------- end info ----------

# ----
# Info
panel_3 = Panel(info.out)

# ----
# Configuration
forward_kinematics = Python3Script(
    model=robot_model,
    a_cart=Slider(1.828, range=0..4.2),
    a_a1=number_slider,
    a_a2=Slider(-46.3, range=-90..150),
    a_a3=Slider(46.9, range=-180..180),
    a_a4=Slider(-94.2, range=-400..400),
    a_a5=Slider(36, range=-125..120),
    a_a6=Slider(-400, range=-400..400))  # -> configuration
# ---------- forward_kinematics: Python ----------
import math

from compas_robots.model import Joint
from compas_robots import Configuration


if model:
    joint_positions = [a_cart, a_a1, a_a2, a_a3, a_a4, a_a5, a_a6]
    print (joint_positions)
    joint_types = model.get_joint_types()
    print(joint_types)
    joint_names = model.get_configurable_joint_names()
    print(joint_names)

    for i, joint_type in enumerate(joint_types):
        if joint_type == Joint.REVOLUTE:
            joint_positions[i] = math.radians(joint_positions[i])
        if joint_type == Joint.PRISMATIC:
            joint_positions[i] = joint_positions[i]
    
    configuration = Configuration(joint_positions, joint_types, joint_names)
    print (configuration)
# ---------- end forward_kinematics ----------

# ----
# Visualisation
show_frames = BooleanToggle(True)
show_visual = BooleanToggle(True)
show_collision = BooleanToggle(True)
show_base_frame = BooleanToggle(True)
show_end_effector_frame = BooleanToggle(True)
show_acm = BooleanToggle(True)
visualise = Python3Script(
    model=robot_model,
    configuration=forward_kinematics,
    show_frames=show_frames,
    show_visual_meshes=show_visual,
    show_collision_meshes=show_collision,
    show_base_frame=show_base_frame,
    show_end_effector_frame=show_end_effector_frame,
    show_attached_collision_meshes=show_acm)  # -> out, joint_planes, visual_meshes, collision_meshes, base_plane, end_effector_plane, attched_collision_meshes
# ---------- visualise: Python ----------
from compas.geometry import Frame
from compas.geometry import Transformation
from compas_rhino.conversions import frame_to_rhino

if show_frames == True: 
    #print(configuration)
    joint_frames = model.transformed_frames(configuration)
    joint_planes = [frame_to_rhino(a) for a in joint_frames]

if show_base_frame == True:
    show_base_frame = model.forward_kinematics(configuration, model.get_base_link_name())
    #print(show_base_frame)
    base_plane = frame_to_rhino(show_base_frame) 

if show_end_effector_frame == True:
    end_effector_frame = model.forward_kinematics(configuration, model.get_end_effector_link_name())
    #print(end_effector_frame)
    end_effector_plane = frame_to_rhino(end_effector_frame) 

if show_visual_meshes == True:
    pass

if show_collision_meshes == True:
    pass

if show_attached_collision_meshes == True:
    pass
# ---------- end visualise ----------
pln = Plane(visualise.joint_planes)
pln_2 = Plane(visualise.end_effector_plane)
pln_3 = Plane(visualise.base_plane)

# ----
# Visualisation
show_end_effector_frame_2 = BooleanToggle(True)
show_base_frame_2 = BooleanToggle(False)
show_collision_2 = BooleanToggle(False)
show_frames_2 = BooleanToggle(False)
show_visual_2 = BooleanToggle(True)
show_acm_2 = BooleanToggle(False)
robot_visualize = RobotVisualize(
    model=robot_model,
    configuration=forward_kinematics,
    redraw=attach_remove.bang,
    show_visual=show_visual_2,
    show_collision=show_collision_2,
    show_frames=show_frames_2,
    show_base_frame=show_base_frame_2,
    show_end_effector_frame=show_end_effector_frame_2,
    show_acm=show_acm_2)  # -> visual, collision, attached_meshes, frames, base_frame, ee_frame; inputs redraw: list, show_visual: Boolean, show_collision: Boolean, show_frames: Boolean, show_base_frame: Boolean, show_end_effector_frame: Boolean, show_acm: Boolean; disabled
#   port configuration: The robot's full configuration.
#   port redraw: A list of attached collision meshes.
#   port show_visual: Whether or not to show the robot's visual meshes.
#   port show_collision: Whether or not to show the robot's collision meshes.
#   port show_frames: Whether or not to show the robot's joint frames.
#   port show_base_frame: Whether or not to show the robot's base frame.
#   port show_end_effector_frame: Whether or not to show the robot's end-effector frame.
#   port show_acm: Whether or not to show the attached collision meshes (if any).
#   port visual: The robot's visual Rhino meshes (if any).
#   port collision: The robot's collision Rhino meshes (if any).
#   port attached_meshes: The attached collision Rhino meshes (if any).
#   port frames: The robot's joint frames as Rhino planes (if any).
#   port base_frame: The robot's base frame as a Rhino plane (if any).
#   port ee_frame: The robot's end-effector frame as a Rhino plane (if any).
# ---------- robot_visualize: Python ----------
"""
Visualizes the robot.

COMPAS FAB v0.19.1
"""
from compas.geometry import Frame
from compas.geometry import Transformation
from compas_ghpython.artists import Artist
from ghpythonlib.componentbase import executingcomponent as component


class RobotVisualize(component):
    def RunScript(self, robot, group, configuration, attached_collision_meshes, show_visual, show_collision,
                  show_frames, show_base_frame, show_end_effector_frame, show_acm):

        visual = None
        collision = None
        attached_meshes = None
        frames = None
        base_frame = None
        ee_frame = None

        if robot:
            show_visual = True if show_visual is None else show_visual
            configuration = configuration or robot.zero_configuration()

            robot.update(configuration, visual=show_visual, collision=show_collision)
            compas_frames = robot.transformed_frames(configuration, group)

            if show_visual:               
                visual = robot.artist.draw_visual()
                

            if show_collision:
                collision = robot.artist.draw_collision()

            if show_base_frame:
                base_compas_frame = compas_frames[0]
                base_frame = Artist(base_compas_frame).draw()

            if show_end_effector_frame:
                ee_compas_frame = robot.forward_kinematics(configuration, group, options=dict(solver='model'))
                ee_frame = Artist(ee_compas_frame).draw()

            if show_frames:
                frames = []
                for compas_frame in compas_frames[1:]:
                    frame = Artist(compas_frame).draw()
                    frames.append(frame)

            if show_acm:
                attached_meshes = []
                for acm in attached_collision_meshes:
                    frame = robot.forward_kinematics(configuration, options=dict(solver='model', link_name=acm.link_name))
                    T = Transformation.from_frame_to_frame(Frame.worldXY(), frame)
                    mesh = acm.collision_mesh.mesh.transformed(T)
                    attached_meshes.append(Artist(mesh).draw())

        return (visual, collision, attached_meshes, frames, base_frame, ee_frame)
# ---------- end robot_visualize ----------
draw = GhPythonScript(frames=[robot_visualize.frames, robot_visualize.base_frame, robot_visualize.ee_frame], scale=Slider(0.2, range=0..1))  # -> P, V, C, W; inputs frames: list
# ---------- draw: Python ----------
from System.Drawing import Color
from compas_ghpython.artists import FrameArtist

red = Color.FromArgb(255, 0, 0)
green = Color.FromArgb(0, 255, 0)
blue = Color.FromArgb(0, 0, 255)

P = []
V = []
C = []

scale = float(scale)

for plane in frames:
    if not plane:
        continue
    P += [plane.Origin] * 3
    V.append(plane.XAxis * scale)
    V.append(plane.YAxis * scale)
    V.append(plane.ZAxis * scale)
    C += [red, green, blue]

W = 3
# ---------- end draw ----------
geo = Geometry([robot_visualize.visual, robot_visualize.collision, robot_visualize.attached_meshes])
preview = CustomPreview(Geometry=geo, Shader=ColourSwatch(SwatchColor=RGB(207, 157, 160)))
vdisex = VectorDisplayEx(Point=draw.P, Vector=draw.V, Colour=draw.C, Width=draw.W)

# ==== cluster Tools

# ---- group: measurement tool
geo = Geometry(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)
mesh = Mesh(geo)
mjoin = MeshJoin(Meshes=mesh)
xaxis_line = Curve(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)
yaxis_line = Curve(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)
tool = PythonScript(rhmesh=mjoin, xline=xaxis_line, yline=yaxis_line)  # -> tool; inputs rhmesh: Mesh
# ---------- tool: Python ----------
import Rhino.Geometry as rg
import os, math
from compas.geometry import Frame, Rotation
from compas.datastructures import Mesh
from compas_ghpython.artists import MeshArtist
from compas_fab.robots import Tool
from compas_rhino.geometry import RhinoMesh

xaxis = rg.Line(xline.PointAtStart, xline.PointAtEnd)
yaxis = rg.Line(yline.PointAtStart, yline.PointAtEnd)

if xaxis.From.DistanceTo(yaxis.From) < 0.01:
    origin = xaxis.From
    xaxis = xaxis.Direction
    yaxis = yaxis.Direction
elif xaxis.To.DistanceTo(yaxis.To) < 0.01:
    origin = xaxis.To
    xaxis = -xaxis.Direction
    yaxis = -yaxis.Direction
elif xaxis.From.DistanceTo(yaxis.To) < 0.01:
    origin = xaxis.From
    xaxis = xaxis.Direction
    yaxis = -yaxis.Direction
elif xaxis.To.DistanceTo(yaxis.From) < 0.01:
    origin = xaxis.To
    xaxis = -xaxis.Direction
    yaxis = yaxis.Direction

xaxis.Unitize()
yaxis.Unitize()

ee_frame = Frame(origin, xaxis, yaxis)
ee_mesh = RhinoMesh.from_geometry(rhmesh).to_compas()

tool = Tool(ee_mesh, ee_frame)
# ---------- end tool ----------

# ---- group: concrete extruder tool
geo_2 = Geometry(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)
mesh_2 = Mesh(geo_2)
mjoin_2 = MeshJoin(Meshes=mesh_2)
yaxis_line_2 = Curve(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)
xaxis_line_2 = Curve(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)

# ----
tool_2 = PythonScript(rhmesh=mjoin_2, xline=xaxis_line_2, yline=yaxis_line_2)  # -> tool; inputs rhmesh: Mesh; same code as tool
G = ClusterInput()
filter = StreamFilter(Gate=G, Stream0=tool, Stream1=tool_2)
s_0 = ClusterOutput(filter)
