# Grasshopper definition fabtory_artist.ghx (Grasshopper 1.0.7)

reload = Button()
path = PythonScript()  # -> HERE, DATA, ROBOT_DESCRIPTION
# ---------- path: Python ----------
import os

HERE = os.path.dirname(ghdoc.Path)
DATA = os.path.abspath(os.path.join(HERE, "..", "data"))
ROBOT_DESCRIPTION = os.path.abspath(os.path.join(DATA, "robot_description"))

print(HERE)
print(DATA)
print(ROBOT_DESCRIPTION)
# ---------- end path ----------
py = PythonScript(reload=reload)
# ---------- py: Python ----------
if reload:
    from compas_ghpython import unload_modules
    unload_modules('compas')
    unload_modules("compas_fab")
    unload_modules("ur_online_control")
# ---------- end py ----------

# ----
# Robot Model
# Load robot from local package
panel = Panel("abb_fabtory.urdf")
list = ValueList({"abb_fabtory"}, selected="abb_fabtory")
py_2 = PythonScript()  # -> packages
# ---------- py_2: Python ----------
packages = ["abb_irb6700_support", "abb_end_effectors", "abb_fabtory"]
# ---------- end py_2 ----------
py_3 = PythonScript(path=path.ROBOT_DESCRIPTION, package=list, urdf_name=panel, srdf_name="abb_fabtory.srdf")  # -> package_path, urdf_filename, srdf_filename
# ---------- py_3: Python ----------
import os

package_path = os.path.join(path, package)
print(package_path)

urdf_filename = os.path.join(package_path, "urdf", urdf_name)
srdf_filename = os.path.join(package_path, srdf_name)

assert os.path.isfile(urdf_filename)
assert os.path.isfile(srdf_filename)
# ---------- end py_3 ----------
py_4 = PythonScript(path=path.ROBOT_DESCRIPTION, packages=py_2)  # -> loaders; inputs packages: list
# ---------- py_4: Python ----------
from compas.robots import LocalPackageMeshLoader

loaders = []
print packages


for package in packages:
    loaders.append(LocalPackageMeshLoader(path, package))
# ---------- end py_4 ----------
units = ValueList({"m": 1, "cm": 100, "mm": 1000}, selected="m")
load = Button()
create = PythonScript(loaders=py_4, urdf_filename=py_3.urdf_filename, srdf_filename=py_3.srdf_filename, scale_factor=units, load=load)  # -> robot; inputs loaders: list
# ---------- create: Python ----------
import os
from scriptcontext import sticky as st

import compas

from compas.robots import RobotModel
from compas.robots import LocalPackageMeshLoader

from compas_fab.robots import Robot
from compas_fab.robots import RobotSemantics

from compas_fab.ghpython import RobotArtist

compas.PRECISION = '12f'

# store robot in component
guid = str(ghenv.Component.InstanceGuid)
robot_key = "robot_" + guid

if robot_key not in st:
    st[robot_key] = None

print loaders

if load:
    model = RobotModel.from_urdf_file(urdf_filename)
    
    model.load_geometry(*loaders)
    artist = RobotArtist(model)
    semantics = RobotSemantics.from_srdf_file(srdf_filename, model)
    robot = Robot(model, artist, semantics, client=None)
    
    st[robot_key] = robot

robot = st[robot_key]


if robot:
    robot.scale(scale_factor)
# ---------- end create ----------

# ----
# Visualisation
toggle = BooleanToggle(True)
robot_visualize = RobotVisualize(
    robot=create,
    show_visual=toggle,
    show_collision=Toggle(False),
    show_frames=Toggle(False),
    show_base_frame=Toggle(False),
    show_end_effector_frame=Toggle(True),
    show_acm=Toggle(False))  # -> visual, collision, attached_meshes, frames, base_frame, ee_frame; inputs redraw: list, show_visual: Boolean, show_collision: Boolean, show_frames: Boolean, show_base_frame: Boolean, show_end_effector_frame: Boolean, show_acm: Boolean
#   port group: The planning group used for end-effector and base visualization.
#   port configuration: The robot's full configuration.
#   port redraw: A list of attached collision meshes.
#   port show_visual: Whether or not to show the robot's visual meshes.
#   port show_collision: Whether or not to show the robot's collision meshes.
#   port show_frames: Whether or not to show the robot's joint frames.
#   port show_base_frame: Whether or not to show the robot's base frame.
#   port show_end_effector_frame: Whether or not to show the robot's end-effector frame.
#   port show_acm: Whether or not to show the attached collision meshes (if any).
#   port visual: The robot's visual Rhino meshes (if any).
#   port collision: The robot's collision Rhino meshes (if any).
#   port attached_meshes: The attached collision Rhino meshes (if any).
#   port frames: The robot's joint frames as Rhino planes (if any).
#   port base_frame: The robot's base frame as a Rhino plane (if any).
#   port ee_frame: The robot's end-effector frame as a Rhino plane (if any).
# ---------- robot_visualize: Python ----------
"""
Visualizes the robot.

COMPAS FAB v0.19.1
"""
from compas.geometry import Frame
from compas.geometry import Transformation
from compas_ghpython.artists import FrameArtist
from compas_ghpython.artists import MeshArtist
from ghpythonlib.componentbase import executingcomponent as component


class RobotVisualize(component):
    def RunScript(self, robot, group, configuration, attached_collision_meshes, show_visual, show_collision,
                  show_frames, show_base_frame, show_end_effector_frame, show_acm):

        visual = None
        collision = None
        attached_meshes = None
        frames = None
        base_frame = None
        ee_frame = None

        if robot:
            show_visual = True if show_visual is None else show_visual
            configuration = configuration or robot.zero_configuration()

            robot.update(configuration, visual=show_visual, collision=show_collision)
            compas_frames = robot.transformed_frames(configuration, group)

            if show_visual:
                visual = robot.artist.draw_visual()

            if show_collision:
                collision = robot.artist.draw_collision()

            if show_base_frame:
                base_compas_frame = compas_frames[0]
                artist = FrameArtist(base_compas_frame)
                base_frame = artist.draw()

            if show_end_effector_frame:
                ee_compas_frame = robot.forward_kinematics(configuration, group, options=dict(solver='model'))
                if robot.attached_tool:
                    ee_compas_frame = robot.from_t0cf_to_tcf([ee_compas_frame])[0]
                artist = FrameArtist(ee_compas_frame)
                ee_frame = artist.draw()

            if show_frames:
                frames = []
                for compas_frame in compas_frames[1:]:
                    artist = FrameArtist(compas_frame)
                    frame = artist.draw()
                    frames.append(frame)

            if show_acm:
                attached_meshes = []
                for acm in attached_collision_meshes:
                    frame = robot.forward_kinematics(configuration, options=dict(solver='model', link_name=acm.link_name))
                    T = Transformation.from_frame_to_frame(Frame.worldXY(), frame)
                    mesh = acm.collision_mesh.mesh.transformed(T)
                    attached_meshes.append(MeshArtist(mesh).draw())

        return (visual, collision, attached_meshes, frames, base_frame, ee_frame)
# ---------- end robot_visualize ----------
preview = CustomPreview(
    Geometry=[robot_visualize.visual, robot_visualize.collision, robot_visualize.attached_meshes],
    Material=ColourSwatch(SwatchColor=RGB(92, 115, 130)))
